# Dynamo graph delete_famlies.dyn (Dynamo 2.13.1.3887)
# packages: archi-lab.net 2023.213.1722

file_path = Filename(".\families.csv")
importCSV = Data.ImportCSV(filePath=file_path)
code_block = CodeBlock { 0; }
removeItemAtIndex = List.RemoveItemAtIndex(list=importCSV, indices=code_block)
code_block_2 = CodeBlock { 0; }
removeItemAtIndex_2 = List.RemoveItemAtIndex(list=removeItemAtIndex@L2, indices=code_block_2)
code_block_3 = CodeBlock { 0; }
getItemAtIndex = List.GetItemAtIndex(list=removeItemAtIndex_2, index=code_block_3)

# group: Name Splitter
# Removes the .rfa suffix so the familyname can be found. (.rsplit(".", maxsplit)) method
python_script = Python(IN[0]=getItemAtIndex)  # CPython3
# ---------- python_script.python (24 lines) ----------
# Load the Python Standard and DesignScript Libraries
import sys
import clr
clr.AddReference('ProtoGeometry')
from Autodesk.DesignScript.Geometry import *

# The inputs to this node will be stored as a list in the IN variables.
dataEnteringNode = IN[0]


# Place your code below this line
names = dataEnteringNode
print(names)

new_name_list = []
for name in names:
    splitted_name = name.rsplit(".", maxsplit=1)
    first_part_name = splitted_name[0]
    new_name_list.append(first_part_name)


# Assign your output to the OUT variable.
print(new_name_list)
OUT = new_name_list
# ----------------------------------------
watch = Watch(python_script)

byName = Family.ByName(name=watch)
familyDocument = Family.FamilyDocument(family=byName)
delete = archilab.Revit.Elements.Elements.Delete()  # unwired: element
delete_2 = Element.Delete()  # unwired: element
types = Family.Types(family=byName)
flatten = List.Flatten(list=types)
byFamilyType = FamilyInstance.ByFamilyType(familyType=flatten)
